# Grasshopper definition 1.01.gh (Grasshopper 1.0.8)

# ----
# ELLIPSE
number_slider = Slider(15, range=0..30)
c_script = CSharpScript(radius1=number_slider, radius2=Slider(9, range=0..30), count=Slider(31, range=0..100))  # -> out, a; inputs radius1: Double, radius2: Double, count: Int32
# ---------- c_script: C# ----------
// Grasshopper Script Instance
#region Usings
using System;
using System.Linq;
using System.Collections;
using System.Collections.Generic;
using System.Drawing;

using Rhino;
using Rhino.Geometry;

using Grasshopper;
using Grasshopper.Kernel;
using Grasshopper.Kernel.Data;
using Grasshopper.Kernel.Types;
#endregion

public class Script_Instance : GH_ScriptInstance
{
    #region Notes
    /* 
      Members:
        RhinoDoc RhinoDocument
        GH_Document GrasshopperDocument
        IGH_Component Component
        int Iteration

      Methods (Virtual & overridable):
        Print(string text)
        Print(string format, params object[] args)
        Reflect(object obj)
        Reflect(object obj, string method_name)
    */
    #endregion

    private void RunScript(double radius1, double radius2, int count, ref object a)
    {
        // Write your logic here

        double step = (2 * Math.PI) / count;
        List<Point2d> points = new List<Point2d>();

        for(double i = 0; i<2 * Math.PI; i += step)
        {
            double x = Math.Cos(i) * radius1;
            double y = Math.Sin(i) * radius2;

            Point2d point  = new Point2d(x,y);
            points.Add(point);
        } 
        a = points;
    }
}
# ---------- end c_script ----------
pt = Point(c_script.a)
nurbs = NurbsCurve(Vertices=pt, Degree=Slider(3, range=0..3), Periodic=Toggle(True))  # -> Curve, Length, Domain
crv = Curve(nurbs.Curve)
